# Dynamo graph DetailsToJson.dyn (Dynamo 2.10.1.3976)
# packages: JsonData 2.0.2

# group: Elements Selection
all_elements_in_active_view = ElementsInView()
select_model_elements = DSModelElementsSelection()  # 38 picked in the model; graph input
show_incomplete_elements_in_view = BoolSelector(true)  # graph input

# group: Data capture & structuration
gather_attribute_values = CodeBlock(el=select_model_elements)
# ---------- gather_attribute_values.designscript (4 lines) ----------
String.Replace(el.Id+" "+el.Name," ","_");
el.GetParameterValueByName("AnimationDescriptionFR");
el.GetParameterValueByName("AnimationDescriptionNL");
el.GetParameterValueByName("AnimationOrder");
# ----------------------------------------
sort_elements_and_parameters_by = CodeBlock(id=gather_attribute_values.out0, animationOrder=gather_attribute_values.out3, fr=gather_attribute_values.out1, nl=gather_attribute_values.out2, el=select_model_elements)  # "Sort elements and parameters by Animation Order"
# ---------- sort_elements_and_parameters_by.designscript (9 lines) ----------
l1=List.SortByKey(id,animationOrder);
l2=List.SortByKey(fr, animationOrder);
l3=List.SortByKey(nl, animationOrder);
Dictionary.ValueAtKey(l1, "sortedList");
Dictionary.ValueAtKey(l1, "sortedKeys");
Dictionary.ValueAtKey(l2, "sortedList");
Dictionary.ValueAtKey(l3, "sortedList");
l4=List.SortByKey(el, animationOrder);
Dictionary.ValueAtKey(l4, "sortedList");
# ----------------------------------------
code_block = CodeBlock(id=sort_elements_and_parameters_by.out3, animationOrder=sort_elements_and_parameters_by.out4, fr=sort_elements_and_parameters_by.out5, nl=sort_elements_and_parameters_by.out6) { values=[id,animationOrder,fr,nl]; List.Transpose(values); }

# group: Directory Path & name definition
directory_path = Directory("C:\Users\fd\Documents\01.BBRI\00.DynamoDevs")  # graph input
code_block_2 = CodeBlock(directoryPath=directory_path)
# ---------- code_block_2.designscript (4 lines) ----------
str1 = Document.FilePath(Document.Current);
n1 = FileSystem.FileName(str1, false);
name = n1+".json";
filePath = FileSystem.CombinePath([directoryPath, name]);
# ----------------------------------------

# group: Json creation
code_block_3 = CodeBlock { ["id","AnimationOrder","LegendFR","LegendNL"]; }
byKeysAndValues = JsonObject.ByKeysAndValues(keys=code_block_3, values=code_block.out1@L2, Nesting=false, Option="None")
toJsonFile = JsonData.Utilities.Write.ToJsonFile(jsonObjects=byKeysAndValues, filepath=code_block_2.filePath)

# group: List Elements with missing attributes
code_block_4 = CodeBlock(id=sort_elements_and_parameters_by.out3, animationOrder=sort_elements_and_parameters_by.out4, fr=sort_elements_and_parameters_by.out5, nl=sort_elements_and_parameters_by.out6, elemList=sort_elements_and_parameters_by.out8)
# ---------- code_block_4.designscript (3 lines) ----------
toCheck=id==""||animationOrder==""||fr==""||nl=="";
t1=List.FilterByBoolMask(elemList,toCheck);
Dictionary.ValueAtKey(t1, "in");
# ----------------------------------------
elements_missing_information = Watch(code_block_4.out2)  # graph output

# group: Debug
coloring_incomplete_objects = CodeBlock(el=code_block_4.out2, bool1=show_incomplete_elements_in_view)
# ---------- coloring_incomplete_objects.designscript (5 lines) ----------
t1 = List.FilterByBoolMask(el@L1<1>, bool1);
t2 = Dictionary.ValueAtKey(t1, "in");
t3 = List.Flatten(t2, -1);
color1 = Color.ByARGB(0, 255, 0, 0);
element1 = Elements.Element.OverrideColorInView(t3, color1);
# ----------------------------------------
