# Dynamo graph ParentPartsNumbering.dyn (Dynamo 2.10.1.3976)
# packages: Rhythm 2022.3.3, SteamNodes 1.2.4

select_new_parents = BoolSelector(true)
ʳʰʸᵗʰᵐ_selection_pick = Rhythm.Revit.Selection.Selection.Pick(runIt=select_new_parents)
getParts = Custom[Element.GetParts](ʳʰʸᵗʰᵐ_selection_pick)  # package SteamNodes; Get parts for the elements from Input. Returns Parts and Parent elements
flatten = List.Flatten(list=getParts.Parts)
code_block = CodeBlock(parts=flatten) { parts; }
code_block_2 = CodeBlock(parts=code_block) { l1=Elements.Element.Geometry(parts); l2=List.Flatten(l1, -1); Solid.Centroid(l2); }
boundingBox = Geometry.BoundingBox(geometry=code_block_2.l2@L1)
minPoint = BoundingBox.MinPoint(boundingBox=boundingBox)
point_list_sorting = CodeBlock(list=minPoint)
# ---------- point_list_sorting.designscript (18 lines) ----------
key= Math.Round(list.Z,0);
t2 = List.SortByKey(list, key);
t3 = Dictionary.ValueAtKey(t2, "sortedList");
t4 = Dictionary.ValueAtKey(t2, "sortedKeys");
t5 = List.GroupByKey(t3, t4);
l1 = Dictionary.ValueAtKey(t5, "groups");
k1=Math.Round(l1@L2<1>.Y,0);
t7 = List.SortByKey(l1@L2<1>, k1@L2<1>);
t8 = Dictionary.ValueAtKey(t7, "sortedList");
t9 = Dictionary.ValueAtKey(t7, "sortedKeys");
t10 = List.GroupByKey(t8@L2<1>, t9@L2<1>);
l2 = Dictionary.ValueAtKey(t10, "groups");
k2=Math.Round(l2@L2<1>.X,0);
t11 = List.SortByKey(l2@L2<1>, k2@L2<1>);
t12 = Dictionary.ValueAtKey(t11, "sortedList");
t13 = Dictionary.ValueAtKey(t11, "sortedKeys");
t14 = List.GroupByKey(t12@L2<1>, t13@L2<1>);
l3 = Dictionary.ValueAtKey(t14, "groups");
# ----------------------------------------
list_of_elements = Watch(point_list_sorting.k1)  # graph output
part_list_sorting = CodeBlock(list=code_block, key=point_list_sorting.key, k1=point_list_sorting.k1, k2=point_list_sorting.k2)
# ---------- part_list_sorting.designscript (16 lines) ----------
t2 = List.SortByKey(list, key);
t3 = Dictionary.ValueAtKey(t2, "sortedList");
t4 = Dictionary.ValueAtKey(t2, "sortedKeys");
t5 = List.GroupByKey(t3, t4);
l1 = Dictionary.ValueAtKey(t5, "groups");
t7 = List.SortByKey(l1@L2<1>, k1@L2<1>);
t8 = Dictionary.ValueAtKey(t7, "sortedList");
t9 = Dictionary.ValueAtKey(t7, "sortedKeys");
t10 = List.GroupByKey(t8@L2<1>, t9@L2<1>);
l2 = Dictionary.ValueAtKey(t10, "groups");
t11 = List.SortByKey(l2@L2<1>, k2@L2<1>);
t12 = Dictionary.ValueAtKey(t11, "sortedList");
t13 = Dictionary.ValueAtKey(t11, "sortedKeys");
t14 = List.GroupByKey(t12@L2<1>, t13@L2<1>);
l3 = Dictionary.ValueAtKey(t14, "groups");
List.Flatten(l3,-1);
# ----------------------------------------
watch = Watch(part_list_sorting.l2)
flatten_2 = List.Flatten(list=point_list_sorting.l3)
override_numbering = BoolSelector(false)  # graph input
start_number = DoubleInput(14)  # graph input
code_block_3 = CodeBlock(el=ʳʰʸᵗʰᵐ_selection_pick)
# ---------- code_block_3.designscript (2 lines) ----------
Elements.Element.GetParameterValueByName(el,"AnimationOrder");
Elements.Element.GetParameterValueByName(el,"AnimationType");
# ----------------------------------------
sort = List.Sort(list=code_block_3.out0)
firstItem = List.FirstItem(list=sort)
if_ = If(test=override_numbering, true=start_number, false=firstItem)
firstItem_2 = List.FirstItem(list=code_block_3.out1)
code_block_4 = CodeBlock(x=code_block, startnumber=if_, element=part_list_sorting.out15, type=firstItem_2)
# ---------- code_block_4.designscript (4 lines) ----------
n=1..#(List.Count(x))..1;
nf=startnumber+(n/1000);
Elements.Element.SetParameterByName(element,"AnimationOrder",nf);
Elements.Element.SetParameterByName(element,"AnimationType",type);
# ----------------------------------------
watch_2 = Watch(code_block_4.n)
code_block_5 = CodeBlock(x=watch_2) { x==1; x==3; }
filterByBoolMask = List.FilterByBoolMask(list=flatten_2, mask=code_block_5.out0)
watch_3 = Watch(filterByBoolMask.in)
filterByBoolMask_2 = List.FilterByBoolMask(list=flatten_2, mask=code_block_5.out1)
watch_4 = Watch(filterByBoolMask_2.in)
list_of_elements_2 = Watch(point_list_sorting.l2)  # graph output
