# Dynamo graph MaterialParameterstoParts.dyn (Dynamo 2.13.1.3887)

# group: SELECT BASE ELEMENT
code_block = CodeBlock { 1557092; }
element_by_id = ElementById(Id=code_block)

select_model_element = DSModelElementSelection()  # 1 picked in the model; graph input
code_block_2 = CodeBlock(element=select_model_element) { element; }
getMaterials = Element.GetMaterials(element=code_block_2)
code_block_3 = CodeBlock { "test"; }
parameterByName = Parameter.ParameterByName(element=getMaterials, name=code_block_3)
code_block_4 = CodeBlock {  }
parameter_name = StringInput("test")  # graph input
appearanceParameters = Material.AppearanceParameters(material=getMaterials)
name = Material.Name(material=getMaterials)
structuralParameters = Material.StructuralParameters(material=getMaterials)
materialCategory = Material.MaterialCategory(material=getMaterials)
materialClass = Material.MaterialClass(material=getMaterials)
thermalParameters = Material.ThermalParameters(material=getMaterials)
code_block_5 = CodeBlock(x=thermalParameters) { ""+x+""; }
code_block_6 = CodeBlock { "Subclass"; }
contains = String.Contains(string=code_block_5, searchFor=code_block_6)
filterByBoolMask = List.FilterByBoolMask(list=thermalParameters, mask=contains)
watch = Watch(filterByBoolMask.in)
