# Dynamo graph BIMExpo_01.PlaceholdersandTerrain.dyn (Dynamo 2.10.1.3976)
# packages: archi-lab.net 2022.212.3222

# note: Create Landscape
list_of_functions = CodeBlock()
# ---------- list_of_functions.designscript (16 lines) ----------
/*Fonction that creates a new bigger topography (to give more context)
by extending the original one with a given value */
def CreateNewTopography(category,distance)
{
t1=ElementQueries.OfCategory(Category.ByName(category));
t2 = Revit.Elements.Parameter.ParameterByName(t1,"Surface Area").Value;
t3 = List.SortByKey(t1, t2);
t4 = Dictionary.ValueAtKey(t3, "sortedList");
t5 = List.LastItem(t4);
list1 = Topography.Points(t5);
t6 = (-distance..distance..2*distance);
list2=Point.ByCoordinates(t6<1>,t6,0);
list3=List.Flatten(list2);
list4=List.Join([list1,list3]);
return Topography.ByPoints(list4);
};
# ----------------------------------------
code_block = CodeBlock { "Topography"; 30000; }
code_block_2 = CodeBlock(category=code_block.out0, distance=code_block.out1) { CreateNewTopography(category,distance); }
new_topography = Watch(code_block_2)  # graph output
# note: Generate Placeholders
rooms_by_status = RoomsByStatus()
filterUsefulRooms = CodeBlock(list1=rooms_by_status.PlacedRooms)
# ---------- filterUsefulRooms.designscript (5 lines) ----------
t1=list1.Name;
boolList=String.Contains(t1,"V.V",false);
lRooms=List.FilterByBoolMask(list1,boolList)["out"];
lNames=List.FilterByBoolMask(t1,boolList)["out"];
lLocations=lRooms.Location;
# ----------------------------------------
# note: Create Shared Parameters
create_shared_and_project = BoolSelector(false)  # "Create Shared and Project Parameters"; graph input
archilab_parameter_types = ParameterTypeUi("Area")
archilab_parameter_groups = ParameterGroupUi("PG_DATA")
archilab_parameter_types_2 = ParameterTypeUi("Volume")
code_block_3 = CodeBlock(createSharedParameter=create_shared_and_project, pType1=archilab_parameter_types, group=archilab_parameter_groups, pType2=archilab_parameter_types_2)
# ---------- code_block_3.designscript (18 lines) ----------
a= "BimExpoArea";
v= "BimExpoVolume";
g= "BIMexpo";
createSharedParameter;
pType1;
group;
cat=Category.ByName("Generic Models");
pType2;
[Imperative]
{
if (createSharedParameter==true)
{
Revit.Elements.Parameter.CreateSharedParameter(a, g, pType1, group, true, cat);
Revit.Elements.Parameter.CreateSharedParameter(v, g, pType2, group, true, cat);
Revit.Elements.Parameter.CreateProjectParameter(a, g, pType1, group, true, cat);
Revit.Elements.Parameter.CreateProjectParameter(v, g, pType2, group, true, cat);
}
};
# ----------------------------------------
name_generation = CodeBlock(t3=filterUsefulRooms.lRooms) { t1 = List.Count(t3); t2 = (1..t1); roomPHname = "Room "+t2; PHname= "Placeholder "+t2; }
creating_room_ph = CodeBlock(PHLocation=filterUsefulRooms.lLocations, cat=code_block_3.out6, PHName=name_generation.PHname, rooms=filterUsefulRooms.lRooms, rName=filterUsefulRooms.lNames)
# ---------- creating_room_ph.designscript (8 lines) ----------
PhLocation= Geometry.Translate(PHLocation,0,0,165);
geom=Cuboid.ByLengths(PhLocation,10,10,10);
PH=DirectShape.ByGeometry(geom,cat,DirectShape.DynamoPreviewMaterial,PHName);
level=rooms.GetParameterValueByName ("Level");
rooms.GetParameterValueByName ("Area");
rooms.GetParameterValueByName ("Volume");
number=rooms.GetParameterValueByName ("Number");
mark= rName+"_R"+ number+"_L"+level;
# ----------------------------------------
creating_room_geometry_ph = CodeBlock(room=filterUsefulRooms.lRooms, cat=code_block_3.out6, name=name_generation.roomPHname)
# ---------- creating_room_geometry_ph.designscript (2 lines) ----------
geom=List.Flatten((Revit.Elements.Element.Geometry(room)));
PH = DirectShape.ByGeometry(geom,cat, DirectShape.DynamoPreviewMaterial, name);
# ----------------------------------------
create_parameters_room_ph = CodeBlock(PH=creating_room_ph.PH, a=code_block_3.out0, area=creating_room_ph.out4, v=code_block_3.out1, volume=creating_room_ph.out5, mark=creating_room_ph.mark, PHroom=creating_room_geometry_ph.PH)
# ---------- create_parameters_room_ph.designscript (8 lines) ----------
Revit.Elements.Element.SetParameterByName(PH, a, area);
Revit.Elements.Element.SetParameterByName(PH, v, volume);
Revit.Elements.Element.SetParameterByName(PH, "Mark", mark);
Revit.Elements.Element.SetParameterByName(PH, "Comments", "BIMEXPOPH");
Revit.Elements.Element.SetParameterByName(PHroom, a, area);
Revit.Elements.Element.SetParameterByName(PHroom, v, volume);
Revit.Elements.Element.SetParameterByName(PHroom, "Mark", mark);
Revit.Elements.Element.SetParameterByName(PHroom, "Comments", "BIMEXPOROOM");
# ----------------------------------------
PH = Watch(creating_room_ph.PH)  # graph output
creating_origin_ph = CodeBlock(cat=code_block_3.out6)
# ---------- creating_origin_ph.designscript (4 lines) ----------
geom = Cuboid.ByLengths(Coordinates.BasePoint(), 10, 10, 10);
PH = DirectShape.ByGeometry(geom,cat, DirectShape.DynamoPreviewMaterial, "Placeholder 0");
Revit.Elements.Element.SetParameterByName(PH, "Mark", "ORIGIN");
Revit.Elements.Element.SetParameterByName(PH, "Comments", "BIMEXPOPH");
# ----------------------------------------
origin = Watch(creating_origin_ph.PH)  # graph output
rooms = Watch(creating_room_geometry_ph.PH)  # graph output
