# Dynamo graph BIMExpo_03.wallpreparation.dyn (Dynamo 2.10.1.3976)
# packages: archi-lab.net 2021.25.21, Clockwork for Dynamo 0.7.x 0.75.24

# note: Data formatting - length of lists
# note: intersect Wall faces with Room geometries
# note: Getting Room Level

refresh_calculations = BoolSelector(false)  # graph input

# group: Debug room bounding
wall_types = WallTypes("TPH-42-Plafonnage_(Mur)_01")
code_block = CodeBlock(wt=wall_types, refresh=refresh_calculations)
# ---------- code_block.designscript (12 lines) ----------
el=ElementQueries.OfCategory(Category.ByName("Walls"));
el;
t1 = el.Name;
str1 = WallType.Name(wt);
x1 = t1;
bool1 = t1==str1;
t2 = DSCore.List.FilterByBoolMask(el, bool1);
t3=Dictionary.ValueAtKey(t2, "in");
savebool=Elements.Element.GetParameterValueByName(t3, "Room Bounding");
element1 = Elements.Element.SetParameterByName(t3, "Room Bounding", true);
checkbool=Elements.Element.GetParameterValueByName(t3, "Room Bounding");
refresh;
# ----------------------------------------

# group: Room Selection
rooms_by_status = RoomsByStatus()
code_block_2 = CodeBlock(room=rooms_by_status.PlacedRooms)
# ---------- code_block_2.designscript (4 lines) ----------
t1 = room.Name;
bool1 = String.Contains(t1, "V.V", false);
t3 = DSCore.List.FilterByBoolMask(room, bool1);
Dictionary.ValueAtKey(t3, "out");
# ----------------------------------------

code_block_3 = CodeBlock(WaitFor=code_block.out9, RoomElement=code_block_2.out3) { WaitFor; RoomElement; }

# group: Gather Rooms Information
code_block_4 = CodeBlock(RoomList=code_block_3.RoomElement) { RoomList; }
code_block_5 = CodeBlock(x=code_block_4)
# ---------- code_block_5.designscript (6 lines) ----------
x.Name;
x.GetParameterValueByName("Level");
x.GetParameterValueByName("Unbounded Height");
x.Number;
t1=Elements.Element.Geometry(x);
roomGeom=List.Flatten(t1,-1);
# ----------------------------------------

watch = Watch(code_block_5.out0)

# group: Update parameters of TPH_Panneau & TPH Panneau A Carreler
code_block_6 = CodeBlock { n="TPH_Panneau"; t=FamilyType.ByName(n); }
all_elements_of_family_type = ElementsOfFamilyType(Family_Type=code_block_6.t)
superComponent = Custom[FamilyInstance.SuperComponent](all_elements_of_family_type)  # package Clockwork for Dynamo 0.7.x; Retrieves the supercomponent of a given family instance
code_block_7 = CodeBlock { n="TPH_Panneau_A_Carreler"; t=FamilyType.ByName(n); }
all_elements_of_family_type_2 = ElementsOfFamilyType(Family_Type=code_block_7.t)
superComponent_2 = Custom[FamilyInstance.SuperComponent](all_elements_of_family_type_2)
code_block_8 = CodeBlock(x=all_elements_of_family_type, y=all_elements_of_family_type_2)
# ---------- code_block_8.designscript (6 lines) ----------
DSCore.List.Join([x, y]);
t1=List.Count(x);
t2=List.Count(y);
l1=List.OfRepeatedItem("0",t1);
l2=List.OfRepeatedItem("A",t2);
DSCore.List.Join([l1,l2]);
# ----------------------------------------
checkGeometry = CodeBlock(x=code_block_8.out0) { t1=DSCore.List.FirstItem(x); Elements.Element.Geometry(t1); }  # "Debug.CheckGeometry"
superComponent_3 = Custom[FamilyInstance.SuperComponent](code_block_8.out0)

# group: Extract room bounding elements
boundaries = Custom[archilab_Room.Boundaries](room=code_block_4)  # package archi-lab.net; This node returns all Room bounding curves and elements that generated them (walls, separation lines etc).
name = Element.Name(element=boundaries.element)

# group: Filter room bounding elements (only specific walls)
code_block_9 = CodeBlock(a=name, list=boundaries.element)
# ---------- code_block_9.designscript (13 lines) ----------
b="TPH-42-Enduit_(Mur)";
c="TPH-42-Plafonnage_(Mur)_01";
d="TPH-22-Bloc_Platre_10";
e="TPH-22-Cloison_2faces_Gyproc_fermeture_accès_grenier(+10m²)";
//Get only useful Walls
bool1=a==b||a==c||a==d||a==e;
l0=List.FilterByBoolMask(list,bool1);
l1=Dictionary.ValueAtKey(l0, "in");
//Get Geometry of Walls
t1 = DSCore.List.UniqueItems(l1@L2<1>);
t2 = Elements.Element.Geometry(t1);
l2=List.Flatten(t2<1>,-1);
List.Flatten(l2,-1);
# ----------------------------------------

code_block_10 = CodeBlock(t1=code_block_5.out1, rHeight=code_block_5.out2, room=code_block_5.out0, nRoom=code_block_5.out3, level=code_block_5.out1)
# ---------- code_block_10.designscript (5 lines) ----------
level1=Select.GetLevelByName(t1);
offset=Math.Round(level1.Elevation,3);
pl1=Plane.Offset(Plane.XY(),offset);
pl2=Plane.Offset(pl1,rHeight);
room+"_R"+nRoom+"_L"+level;
# ----------------------------------------

# group: Cut walls at levels
code_block_11 = CodeBlock(g1=code_block_9.l1, g2=code_block_9.l2, plane1=code_block_10.pl1, plane2=code_block_10.pl2)
# ---------- code_block_11.designscript (16 lines) ----------
//Count geometries
num1 = DSCore.List.Count(g1@L2<1>);
num2 = DSCore.List.Count(g2@L2<1>);
//format plane lists according to wall list
l1=DSCore.List.OfRepeatedItem(plane1@L1<1>, num2@L1<1>);
l2=DSCore.List.OfRepeatedItem(plane2@L1<1>, num2@L1<1>);
//Split wall at room level
t1=DSCore.List.Flatten(l1, -1);
geometry1 = Geometry.Split(DSCore.List.Flatten(g2,-1), t1);
//Split wall at room height
t2 = DSCore.List.FirstItem(geometry1@L2<1>);
t3 = DSCore.List.Flatten(l2, -1);
geometry2 = Geometry.Split(t2, t3);
//List Wall geometries split by level and grouped by room
t6 = DSCore.List.LastItem(geometry2@L2<1>);
t7 = DSCore.List.Chop(t6, num2);
# ----------------------------------------

# group: Explode wall geometries into faces
explode = Geometry.Explode(geometry=code_block_11.t7)
code_block_12 = CodeBlock { 1; }
flatten = List.Flatten(amt=code_block_12)  # unwired: list
map = List.Map(list=explode, f_x=flatten)

code_block_13 = CodeBlock(t1=map, t3=code_block_5.roomGeom, geometry2=explode)
# ---------- code_block_13.designscript (6 lines) ----------
num1 = DSCore.List.Count(t1@L2<1>);
t2 = DSCore.List.OfRepeatedItem(t3@L1<1>, num1@L1<1>);
geometry1 = Geometry.Intersect(t1, t2);
num2 = DSCore.List.Count(geometry2@L2<1>);
num3 = DSCore.List.Count(geometry1@L2<1>);
num4 = DSCore.List.Count(geometry2@L2<1>);
# ----------------------------------------

# group (continued): Debug room bounding
reset_bounding_room_values_to = CodeBlock(el=code_block.out7, initialbool=code_block.out8, waitFor=code_block_13.geometry1) { Elements.Element.SetParameterByName(el, "Room Bounding", initialbool); waitFor; }  # "Reset bounding room values to their initials"

# group: Create base wall finishing surfaces
# note: yellow attention mark normal, this is solved by line 4 and 5 in the script
code_block_14 = CodeBlock(geometry1=reset_bounding_room_values_to.waitFor)
# ---------- code_block_14.designscript (10 lines) ----------
//create wall finishing surface
t1 = DSCore.List.Flatten(geometry1, -1);
x= Surface.Area(t1);
bool1 = x==null;
t2 = DSCore.List.FilterByBoolMask(t1, bool1);
Dictionary.ValueAtKey(t2, "out");
t3 = DSCore.List.FilterByBoolMask(x, bool1);
t4 = Dictionary.ValueAtKey(t3, "out");
scalingRatio=10000;
Math.Round(t4/scalingRatio,2);
# ----------------------------------------
code_block_15 = CodeBlock(elem=code_block_9.t1, num2=code_block_13.num2, geometry1=code_block_13.geometry1, bool1=code_block_14.bool1)
# ---------- code_block_15.designscript (10 lines) ----------
//id of the original wall
id = Elements.Element.Id(elem);
t1 = DSCore.List.OfRepeatedItem(id@L1<1>, num2@L1<1>);
t2 = DSCore.List.Flatten(t1, -1);
t3 = DSCore.List.Count(geometry1@L2<1>);
t5 = DSCore.List.OfRepeatedItem(t2@L1<1>, t3@L1<1>);
t6 = DSCore.List.Flatten(t5, -1);
t7 = DSCore.List.FilterByBoolMask(t6, bool1);
t8 = Dictionary.ValueAtKey(t7, "in");
""+Dictionary.ValueAtKey(t7, "out")+"";
# ----------------------------------------
code_block_16 = CodeBlock(rLevel=code_block_10.out4, l1=code_block_13.num1, l2=code_block_13.num3, filterbool=code_block_14.bool1)
# ---------- code_block_16.designscript (8 lines) ----------
//Data formating room name, number & level
t1 = DSCore.List.OfRepeatedItem(rLevel@L1<1>, l1@L1<1>);
t3 = DSCore.List.Flatten(t1, -1);
t4 = DSCore.List.OfRepeatedItem(t3@L1<1>, l2@L1<1>);
t5 = DSCore.List.Flatten(t4, -1);
t6 = DSCore.List.FilterByBoolMask(t5, filterbool);
t7 = Dictionary.ValueAtKey(t6, "out");
DSCore.List.Flatten(t7, -1);
# ----------------------------------------
code_block_17 = CodeBlock(rNumber=code_block_5.out3, l1=code_block_13.num1, l2=code_block_13.num3, filterbool=code_block_14.bool1)
# ---------- code_block_17.designscript (8 lines) ----------
//Data formatting room number
t1 = DSCore.List.OfRepeatedItem(rNumber@L1<1>, l1@L1<1>);
t3 = DSCore.List.Flatten(t1, -1);
t4 = DSCore.List.OfRepeatedItem(t3@L1<1>, l2@L1<1>);
t5 = DSCore.List.Flatten(t4, -1);
t6 = DSCore.List.FilterByBoolMask(t5, filterbool);
t7 = Dictionary.ValueAtKey(t6, "out");
DSCore.List.Flatten(t7, -1);
# ----------------------------------------

# group: Remove TPH Boxes from Wall surfaces + list these surfaces
code_block_18 = CodeBlock { n="TPH_Box"; t=FamilyType.ByName(n); }
all_elements_of_family_type_3 = ElementsOfFamilyType(Family_Type=code_block_18.t)
code_block_19 = CodeBlock(el=all_elements_of_family_type_3)
# ---------- code_block_19.designscript (10 lines) ----------
Elements.Element.Geometry(el);
//Get the parents of all TPbox
elpar=Elements.Element.GetParentElement(el);
//Check if parents' name contains "Habillage"
t1=elpar.Name;
bool1=String.Contains(t1, "Habillage", true);
//Filter TPbox if "habillage" ->in, else -> out
t2=DSCore.List.FilterByBoolMask(el, bool1);
tilesnotincluded=Dictionary.ValueAtKey(t2, "in");
tilesincluded=Dictionary.ValueAtKey(t2, "out");
# ----------------------------------------
code_block_20 = CodeBlock(tilesnotincluded=code_block_19.tilesnotincluded, wallsurf=code_block_14.out4, tilesincluded=code_block_19.tilesincluded)
# ---------- code_block_20.designscript (15 lines) ----------
//Remove surfaces from TPh_box "not included" in walls
t1 = Elements.Element.Geometry(tilesnotincluded);
t2 = DSCore.List.Flatten(t1, -1);
solid1 = Solid.ByUnion(t2);
geometry1 = Surface.SubtractFrom(wallsurf, solid1);
wall1=List.Flatten(geometry1,-1);
//Remove surfaces from TPh_box "included" in walls
t4=Elements.Element.Geometry(tilesincluded);
t5=DSCore.List.Flatten(t4, -1);
solid2 = Solid.ByUnion(t5);
geometry2 = Surface.SubtractFrom(wall1, solid2);
wall2=List.Flatten(geometry2,-1);
//Create a list of "A" for standing of surfaces
t6=List.Count(wall2);
List.OfRepeatedItem("0",t6);
# ----------------------------------------
code_block_21 = CodeBlock(t1=code_block_20.wall1, t2=code_block_20.t5, wallId=code_block_15.out8, room1=code_block_16.out6)
# ---------- code_block_21.designscript (16 lines) ----------
//Create Surfaces of intersection wall vs objects
geometry1 = Geometry.Intersect(t1@L1<1>, t2);
surfA = DSCore.List.Flatten(geometry1, -1);
//Create a list of "A" for standing of surfaces
t3=List.Count(surfA);
List.OfRepeatedItem("A",t3);
//Calculate area of surfaces
Surface.Area(surfA);
//Calcule Base Wall id of intersecting surfaces
bool1 = Geometry.DoesIntersect(t1@L1<1>, t2);
num1 = DSCore.List.CountTrue(bool1@L2<1>);
t4 = DSCore.List.OfRepeatedItem(wallId@L1<1>, num1@L1<1>);
t5 = DSCore.List.Flatten(t4, -1);
//filter room name, number and level (mark)
room = DSCore.List.OfRepeatedItem(room1@L1<1>, num1@L1<1>);
t6 = DSCore.List.Flatten(room, -1);
# ----------------------------------------

code_block_22 = CodeBlock(newrNumber=code_block_17.out6, newrMark=code_block_16.out6) { newrNumber; newrMark; }

# group: Join all surfaces & parameters to create
surfaces = CodeBlock(WallWithoutIntersections=code_block_20.wall2, IntersectionsWallObjects=code_block_21.surfA)
# ---------- surfaces.designscript (4 lines) ----------
WallWithoutIntersections;
IntersectionsWallObjects;
t1=DSCore.List.Join([WallWithoutIntersections,IntersectionsWallObjects]);
Math.Round(t1.Area/10000,2);
# ----------------------------------------
ids = CodeBlock(WallWithoutIntersections=code_block_15.out8, IntersectionsWallObjects=code_block_21.t5)
# ---------- ids.designscript (3 lines) ----------
WallWithoutIntersections;
IntersectionsWallObjects;
DSCore.List.Join([WallWithoutIntersections,IntersectionsWallObjects]);
# ----------------------------------------
mark = CodeBlock(WallWithoutIntersections=code_block_22.newrMark, IntersectionsWallObjects=code_block_21.t6)  # same code as ids
standing_a_0 = CodeBlock(WallWithoutIntersections=code_block_20.out11, IntersectionsWallObjects=code_block_21.out3)  # same code as ids

numbering_all_elements_created = CodeBlock(list=ids.out2, list2=code_block_8.out0) { x=List.Count(list); y=List.Count(list2); 1..x; x+1..(x+y); }  # "Numbering all elements (created and modified)"

# group: Create new elements in Revit and change their parameters
code_block_23 = CodeBlock(t2=surfaces.t1) { solid1 = Surface.Thicken(t2, 0.1, false); }
categories = Categories("OST_Walls")
code_block_24 = CodeBlock(x=numbering_all_elements_created.out2) { "BimExpoWall "+x; }
byGeometry = DirectShape.ByGeometry(geometry=code_block_23, category=categories, name=code_block_24)
code_block_25 = CodeBlock(nameroomlevel=mark.out2, x=numbering_all_elements_created.out2) { nameroomlevel+" [BimExpoWall "+x+"]"; }
code_block_26 = CodeBlock(el=byGeometry, id=ids.out2, area=surfaces.out3, mark=code_block_25, comments=standing_a_0.out2)
# ---------- code_block_26.designscript (9 lines) ----------
a="BimExpoBaseWallId";
b="BimExpoArea";
c="Mark";
d="Comments";
Elements.Element.SetParameterByName(el,a,id);
Elements.Element.SetParameterByName(el,b,area);
Elements.Element.SetParameterByName(el,c,mark);
Elements.Element.SetParameterByName(el,d,comments);
Elements.Element.SetParameterByName(el, "Room Bounding", 0);
# ----------------------------------------
created_walls = Watch(byGeometry)  # graph output

# group: Add parameters to floor with tiles
code_block_27 = CodeBlock(floorlist=boundaries.element, RoomList=code_block_10.out4)
# ---------- code_block_27.designscript (23 lines) ----------
//Check if some room have "carrelage générique"
floorbool=(floorlist.Name=="TPH_43_Carrelage_Générique");
//Only keep floors with "carrelage générique"
t0=DSCore.List.FilterByBoolMask(floorlist,floorbool);
TiledFloor=DesignScript.Dictionary.ValueAtKey(t0, "in");
CleanedTF=List.Flatten((List.Clean(TiledFloor, false)),-1);
//Keep rooms with "carrelage générique"
Anytrue=DSCore.List.AnyTrue(floorbool@L2<1>);
t1=DSCore.List.FilterByBoolMask(RoomList,Anytrue);
FilteredRoomList=DesignScript.Dictionary.ValueAtKey(t1, "in");
//Get Surface area of "carrelage générique"
area=Math.Round(TiledFloor.GetParameterValueByName("Area"),2);
//# of "carrelage générique" and generate a series 1 -> n
n=List.Count(TiledFloor);
x= 1..n;
//create the string for the "name" parameter
name=FilteredRoomList+" [BimExpoFloor "+x+"]";
//generate list of "standing" per floor
standing=List.OfRepeatedItem("A",n);
//Set parameters of "carrelage générique" floors
Elements.Element.SetParameterByName(CleanedTF,"BimExpoArea",area);
Elements.Element.SetParameterByName(CleanedTF,"Mark",name);
Elements.Element.SetParameterByName(CleanedTF,"Comments",standing);
# ----------------------------------------

modified_floors = Watch(code_block_27.name)  # graph output

# group (continued): Update parameters of TPH_Panneau & TPH Panneau A Carreler
code_block_28 = CodeBlock(t1=superComponent_3, x=numbering_all_elements_created.out3)
# ---------- code_block_28.designscript (5 lines) ----------
el=Rhythm.FamilyInstances.Room(t1);
room=el.Name;
level=el.GetParameterValueByName("Level");
nRoom=el.Number;
room+"_R"+nRoom+"_L"+level+" [BimExpoWall "+x+"]";
# ----------------------------------------
modified_walls = Watch(code_block_28.out4)  # graph output
code_block_29 = CodeBlock(el=code_block_8.out0, parent=superComponent_3, mark=code_block_28.out4, comment=code_block_8.out5)
# ---------- code_block_29.designscript (10 lines) ----------
a="BimExpoBaseWallId";
b="BimExpoArea";
c="Mark";
d="Comments";
//Set the parameters to the revit elements
Elements.Element.SetParameterByName(el,a,""+parent.Id);
area=Elements.Element.GetParameterValueByName(el,"TPSurface");
Elements.Element.SetParameterByName(el,b,area);
Elements.Element.SetParameterByName(el,c,mark);
Elements.Element.SetParameterByName(el,d,comment);
# ----------------------------------------
