# Dynamo graph BIMExpo_02.Light&ReflectionProbes.dyn (Dynamo 2.10.1.3976)
# packages: Clockwork for Dynamo 0.7.x 0.75.24

categories = Categories("OST_Roofs")
all_elements_of_category = ElementsOfCategory(Category=categories)
categories_2 = Categories("OST_Ceilings")
all_elements_of_category_2 = ElementsOfCategory(Category=categories_2)
code_block = CodeBlock(t9=all_elements_of_category, t10=all_elements_of_category_2)  # frozen
# ---------- code_block.designscript (49 lines) ----------
element1 = archilab.Elements.Type(t9);
surface1 = HostObject.BottomSurface(t10);
t11 = List.Flatten(surface1, -1);
t2 = (0..1);
t3 = (1..0);
point1 = Surface.PointAtParameter(t11<1>, t2<2>, t3<3>);
t12 = List.Flatten(point1@L3<1>, 1);
t4 = [0, 1, 3, 2];
t13 = List.Reorder(t12@L2<1>, t4);
surface2 = Surface.ByPerimeterPoints(t13);
num4 = Surface.Area(surface2);
x = num4;
t5 = (x/10000);
x1 = Math.Ceiling(t5);
lux = 200;
lmintensity = 1500;
t6 = (x1*lux)/lmintensity;
num5 = Math.Ceiling(t6);
x2 = Math.Sqrt(num5);
t7 = x2+2;
num6 = Math.Ceiling(t7);
t14 = List.OfRepeatedItem(t11@L1<1>, num6@L1<1>);
t15 = List.OfRepeatedItem(t14@L2<1>, num6@L1<1>);
t16 = List.Flatten(t15, -1);
x3 = num6;
t8 = x3*x3;
t17 = List.Chop(t16, t8);
x4 = num6;
t1 = (0..1..#x4);
t18 = List.Cycle(t1@L2<1>, num6@L1<1>);
t19 = List.Flatten(t18, -1);
t20 = List.Chop(t19, t8);
t21 = List.Flatten(t1, -1);
t22 = List.OfRepeatedItem(num6@L1<1>, num6@L1<1>);
t23 = List.Flatten(t22, -1);
t24 = List.OfRepeatedItem(t21@L1<1>, t23@L1<1>);
t25 = List.Flatten(t24, -1);
t26 = List.Chop(t25, t8);
point2 = Surface.PointAtParameter(t17, t20, t26);
bool2 = Geometry.DoesIntersect(t17, point2);
t27 = List.FilterByBoolMask(t17, bool2);
t28 = Dictionary.ValueAtKey(t27, "in");
t29 = Dictionary.ValueAtKey(t27, "out");
t30 = List.FilterByBoolMask(point2, bool2);
t31 = Dictionary.ValueAtKey(t30, "in");
t32 = Dictionary.ValueAtKey(t30, "out");
curve1 = Surface.PerimeterCurves(t28);
x5 = Geometry.DistanceTo(t31, curve1);
bool1 = x5<=50;
# ----------------------------------------
string_from_object = FromObject(object=code_block.element1)
anyTrue = Custom[Clockwork_List.AnyTrue](seq=code_block.bool1@L2)  # package Clockwork for Dynamo 0.7.x; Returns true if any item in a list of booleans is true.
code_block_2 = CodeBlock(t10=code_block.t11, t11=code_block.t28, t13=anyTrue, t14=code_block.t31)
# ---------- code_block_2.designscript (21 lines) ----------
lux = Surface.Area(t10);
t5 = lux/10000;
x2 = Math.Ceiling(t5);
lmintensity = num3;
t6 = (x2*lux)/lmintensity;
t7 = t6/4;
num3 = List.Count(t11@L2<1>);
t12 = List.Chop(t13, num3);
t15 = List.FilterByBoolMask(t14, t12);
t16 = Dictionary.ValueAtKey(t15, "in");
t17 = Dictionary.ValueAtKey(t15, "out");
t18=List.Clean(t17,false);
num4 = List.Count(t18);
t2 = (t6-num4);
n = List.Count(t18@L2<1>);
lux1=200;
t3 =(x2*lux1)/n;
vector1 = Vector.ZAxis();
geometry1 = Geometry.Translate(t18, vector1, -20);
Sphere.ByCenterPointRadius(geometry1,15);
//familyinstance1 = FamilyInstance.ByPoint(t24, geometry1);
# ----------------------------------------
watch = Watch(code_block_2.out19)
family_types = FamilyTypes("TPH_56_Chaudiere_VIESS:Chaudiere_ECS_Integre_Mur")
watch_2 = Watch(code_block.t31)
watch_3 = Watch(code_block.bool1)
watch_4 = Watch()  # unwired: arg0
code_block_3 = CodeBlock(t2=code_block_2.t17) { t3 = List.Clean(t2, false); }
code_block_4 = CodeBlock(x=code_block_3) { List.Count(x@L2<1>); }
code_block_5 = CodeBlock(x=code_block_2.geometry1) { x; }
categories_3 = Categories("OST_GenericModel")
code_block_6 = CodeBlock { "Light"; "Light2"; }
byGeometry = DirectShape.ByGeometry(geometry=code_block_2.out19, category=categories_3, name=code_block_6.out0)
rooms_by_status = RoomsByStatus()
code_block_7 = CodeBlock(x=rooms_by_status.PlacedRooms) { y=x.Name; String.Contains(y,"V.V.",true); }
filterByBoolMask = List.FilterByBoolMask(list=rooms_by_status.PlacedRooms, mask=code_block_7.out1)
code_block_8 = CodeBlock(x=filterByBoolMask.out) { Elements.Element.Geometry(x); }
flatten = List.Flatten(list=code_block_8)
explode = Geometry.Explode(geometry=flatten)
code_block_9 = CodeBlock { 0.5; }
normalAtParameter = Surface.NormalAtParameter(surface=explode, u=code_block_9, v=code_block_9)
Z = Vector.Z(vector=normalAtParameter)
code_block_10 = CodeBlock(x=Z) { x==1; }
filterByBoolMask_2 = List.FilterByBoolMask(list=explode, mask=code_block_10)
code_block_11 = CodeBlock(x=filterByBoolMask_2.in) { x; }
code_block_12 = CodeBlock(x=code_block_11) { x; }
code_block_13 = CodeBlock(surface1=code_block_12)
# ---------- code_block_13.designscript (47 lines) ----------
t11 = List.Flatten(surface1, -1);
t2 = (0..1);
t3 = (1..0);
point1 = Surface.PointAtParameter(t11<1>, t2<2>, t3<3>);
t12 = List.Flatten(point1@L3<1>, 1);
t4 = [0, 1, 3, 2];
t13 = List.Reorder(t12@L2<1>, t4);
surface2 = Surface.ByPerimeterPoints(t13);
num4 = Surface.Area(surface2);
x = num4;
t5 = (x/10000);
x1 = Math.Ceiling(t5);
lux = 200;
lmintensity = 1500;
t6 = (x1*lux)/lmintensity;
num5 = Math.Ceiling(t6);
x2 = Math.Sqrt(num5);
t7 = x2+2;
num6 = Math.Ceiling(t7);
t14 = List.OfRepeatedItem(t11@L1<1>, num6@L1<1>);
t15 = List.OfRepeatedItem(t14@L2<1>, num6@L1<1>);
t16 = List.Flatten(t15, -1);
x3 = num6;
t8 = x3*x3;
t17 = List.Chop(t16, t8);
x4 = num6;
t1 = (0..1..#x4);
t18 = List.Cycle(t1@L2<1>, num6@L1<1>);
t19 = List.Flatten(t18, -1);
t20 = List.Chop(t19, t8);
t21 = List.Flatten(t1, -1);
t22 = List.OfRepeatedItem(num6@L1<1>, num6@L1<1>);
t23 = List.Flatten(t22, -1);
t24 = List.OfRepeatedItem(t21@L1<1>, t23@L1<1>);
t25 = List.Flatten(t24, -1);
t26 = List.Chop(t25, t8);
point2 = Surface.PointAtParameter(t17, t20, t26);
bool2 = Geometry.DoesIntersect(t17, point2);
t27 = List.FilterByBoolMask(t17, bool2);
t28 = Dictionary.ValueAtKey(t27, "in");
t29 = Dictionary.ValueAtKey(t27, "out");
t30 = List.FilterByBoolMask(point2, bool2);
t31 = Dictionary.ValueAtKey(t30, "in");
t32 = Dictionary.ValueAtKey(t30, "out");
curve1 = Surface.PerimeterCurves(t28);
x5 = Geometry.DistanceTo(t31, curve1);
bool1 = x5<=50;
# ----------------------------------------
anyTrue_2 = Custom[Clockwork_List.AnyTrue](seq=code_block_13.bool1@L2)
code_block_14 = CodeBlock(t10=code_block_13.t11, t11=code_block_13.t28, t13=anyTrue_2, t14=code_block_13.t31)  # same code as code_block_2
byGeometry_2 = DirectShape.ByGeometry(geometry=code_block_14.out19, category=categories_3, name=code_block_6.out0)
code_block_15 = CodeBlock { x; }  # unwired: x
contains = String.Contains()  # unwired: str, searchFor
