# Dynamo graph Camera.dyn (Dynamo 2.10.1.3976)
# packages: Rhythm 2022.3.3

categories = Categories("OST_Views")
all_elements_of_category = ElementsOfCategory(Category=categories)
code_block = CodeBlock { false; }
clean = List.Clean(list=all_elements_of_category, preserveIndices=code_block)
code_block_2 = CodeBlock(x=clean) { y=x.Name; String.Contains(y,"camera ",false); }
filterByBoolMask = List.FilterByBoolMask(list=clean, mask=code_block_2.out1)
parameters = Element.Parameters(element=filterByBoolMask.in)
filterByBoolMask_2 = List.FilterByBoolMask(list=code_block_2.y, mask=code_block_2.out1)
filterByBoolMask_3 = List.FilterByBoolMask(list=all_elements_of_category, mask=code_block_2.out1)
origin = View.Origin(view=filterByBoolMask.in)
viewDirection = View.ViewDirection(view=filterByBoolMask.in)
reverse = Vector.Reverse(vector=viewDirection)
code_block_3 = CodeBlock { 100; }
byStartPointDirectionLength = Line.ByStartPointDirectionLength(startPoint=origin, direction=reverse, length=code_block_3)
byCurve = ModelCurve.ByCurve(curve=byStartPointDirectionLength)  # frozen
code_block_4 = CodeBlock { 1000; }
byLengths = Cuboid.ByLengths(origin=origin, width=code_block_4, length=code_block_4, height=code_block_4)
categories_2 = Categories("OST_GenericModel")
code_block_5 = CodeBlock(x=filterByBoolMask.in) { x.Name; }
byGeometry = DirectShape.ByGeometry(geometry=byLengths, category=categories_2, name=code_block_5)
code_block_6 = CodeBlock { "Comments"; }
code_block_7 = CodeBlock(x=reverse) { str="["+x.X+","+x.Y+","+x.Z+"]"; }
ʳʰʸᵗʰᵐ_elements = Rhythm.Revit.Elements.Elements.SetParameterValueByNameCaSeiNSeNSiTiVe(element=byGeometry, parameterName=code_block_6, value=code_block_7)
toString = Element.ToString(element=reverse)  # unwired: format, formatProvider
code_block_8 = CodeBlock(x=reverse) { x.X; }
string_from_object = FromObject(object=code_block_8)
code_block_9 = CodeBlock(x=code_block_8) { str=x+""; }
code_block_10 = CodeBlock(x=reverse) { str="["+x.X+"/"+x.Y+"/"+x.Z+"]"; }
code_block_11 = CodeBlock { ","; "."; "/"; }
replace = String.Replace(string=code_block_10, searchFor=code_block_11.out0, replaceWith=code_block_11.out1)
replace_2 = String.Replace(string=replace, searchFor=code_block_11.out2, replaceWith=code_block_11.out0)
