# Dynamo graph ColorToxicity.dyn (Dynamo 2.6.1.8786)
# packages: Rhythm 2019.12.4, Clockwork for Dynamo 2.x 2.3.0

# group: Load all walls from the project
categories = Categories("OST_Walls")
all_elements_of_category = ElementsOfCategory(Category=categories)

list_of_walls = Watch(all_elements_of_category)
parameter_to_check = CodeBlock { "Contains toxic material"; }

# group: Check paremeter for every element
ʳʰʸᵗʰᵐ_elements = Rhythm.Revit.Elements.Elements.GetParameterValueByNameCaSeiNSeNSiTiVe(element=all_elements_of_category, parameterName=parameter_to_check)
code_block = CodeBlock(x=ʳʰʸᵗʰᵐ_elements) { x==1; }

# group: Filter toxic/non toxic elements
filterByBoolMask = List.FilterByBoolMask(list=all_elements_of_category, mask=code_block)
code_block_2 = CodeBlock(Toxic=filterByBoolMask.in) { Toxic; }
code_block_3 = CodeBlock(NonToxic=filterByBoolMask.out) { NonToxic; }

# group: Color toxic in red non toxic in grey
red = Custom[Color.Red]()  # package Clockwork for Dynamo 2.x; Returns the colour red.
overrideColorInView = Element.OverrideColorInView(element=code_block_2, color=red)
grey = Custom[Color.Grey]()  # package Clockwork for Dynamo 2.x; Returns the colour grey.
overrideColorInView_2 = Element.OverrideColorInView(element=code_block_3, color=grey)

list_of_walls_containing_toxic = Watch(code_block_2)  # "List of walls containing toxic materials"
list_of_walls_without_toxic = Watch(code_block_3)  # "List of walls without toxic materials"
