# Dynamo graph TestFCRBE.dyn (Dynamo 2.6.1.8786)
# packages: Clockwork for Dynamo 2.x 2.3.0, Dynamo Text 2.0.1, Rhythm 2019.12.4

# note: Script Name: TestFCRBE.dyn
# Packages used in this script:
# Clockwork for Dynamo 0.7.x version: 0.75.24
# Rhythm version: 2019.12.4
# TimeStamp : 2022/3/11 12:23

categories = Categories("OST_Rooms")
all_elements_of_category = ElementsOfCategory(Category=categories)
name = Room.Name(room=all_elements_of_category)

# group: Select all windows, create a bounding box (check if it can be moved within the building) with security margin
categories_2 = Categories("OST_Windows")
all_elements_of_category_2 = ElementsOfCategory(Category=categories_2)
geometry = Element.Geometry(element=all_elements_of_category_2)
byGeometry = BoundingBox.ByGeometry(geom=geometry)
toCuboid = BoundingBox.ToCuboid(boundingBox=byGeometry)

# group: Select all windows, create a section per window
categories_3 = Categories("OST_Windows")
all_elements_of_category_3 = ElementsOfCategory(Category=categories_3)
geometry_2 = Element.Geometry(element=all_elements_of_category_3)
byGeometry_2 = BoundingBox.ByGeometry(geom=geometry_2)

# group: Scales the bounding box and move it to the centre of the element
code_block = CodeBlock { 1.5; }
scale = Geometry.Scale(geometry=toCuboid, xamount=code_block, yamount=code_block, zamount=code_block)
centroid = Solid.Centroid(solid=scale)
toCuboid_2 = BoundingBox.ToCuboid(boundingBox=byGeometry_2)
centroid_2 = Solid.Centroid(solid=toCuboid_2)
byTwoPoints = Vector.ByTwoPoints(start=centroid, end=centroid_2)
translate = Geometry.Translate(geometry=scale, direction=byTwoPoints)

# group: List all elements in a given view and gives their category
all_elements_in_active_view = ElementsInView()
watch = Watch(all_elements_in_active_view)
getCategory = Element.GetCategory(element=all_elements_in_active_view)
watch_2 = Watch(getCategory)
parameters = Element.Parameters(element=all_elements_in_active_view)
watch_3 = Watch(parameters)

code_block_2 = CodeBlock { "wall export"; }
code_block_3 = CodeBlock { 1; 1; }
code_block_4 = CodeBlock { false; }

# group: Export data in a structured way to datasheets
file_path = Filename(".\TestFCRBE.xlsx")
exportExcel = Data.ExportExcel(filePath=file_path, sheetName=code_block_2, startRow=code_block_3.out0, startCol=code_block_3.out1, overWrite=code_block_4)  # unwired: data

# group: Get data from each layer of a wall
wall_types = WallTypes("Exterior - Block on Mtl. Stud")
compoundStructureLayers = Custom[FamilyType.CompoundStructureLayers](wall_types)  # package Clockwork for Dynamo 2.x; Retrieves the compound layers of any layered family type (wall types, roof types, floor types etc.)
name_2 = Family.Name(family=compoundStructureLayers.Materials)
watch_4 = Watch(name_2)
parameters_2 = Element.Parameters(element=compoundStructureLayers.Materials)
watch_5 = Watch(parameters_2)

string_from_object = FromObject(obj=all_elements_of_category_3)
uniqueItems = List.UniqueItems(list=string_from_object)
allIndicesOf = List.AllIndicesOf(list=string_from_object, item=uniqueItems)
firstItem = List.FirstItem(list=allIndicesOf@L2)
getItemAtIndex = List.GetItemAtIndex(list=geometry_2, index=firstItem)
byGeometry_3 = BoundingBox.ByGeometry(geom=getItemAtIndex)
toCuboid_3 = BoundingBox.ToCuboid(boundingBox=byGeometry_3)
centroid_3 = Solid.Centroid(solid=toCuboid_3)
code_block_5 = CodeBlock(windows=uniqueItems) { n=DSCore.List.Count(windows); 0..n-1; }
code_block_6 = CodeBlock(y=code_block_5.out1) { Point.ByCoordinates(0,y,0); }
byTwoPoints_2 = Vector.ByTwoPoints(start=centroid_3, end=code_block_6)
translate_2 = Geometry.Translate(geometry=getItemAtIndex, direction=byTwoPoints_2)
count = List.Count(list=allIndicesOf@L2)
code_block_7 = CodeBlock(name=uniqueItems, count=count) { "Type: "+name+" - amount: " + count; }
code_block_8 = CodeBlock(geom=code_block_6) { Geometry.Translate(geom,2,0,0); }
code_block_9 = CodeBlock { 0.5; }
fromStringOriginAndScale = DynamoText.Text.FromStringOriginAndScale(text=code_block_7, origin=code_block_8, scale=code_block_9)
number_slider = DoubleSlider(10, range=-100..100 step 5)
number_slider_2 = DoubleSlider(-10, range=-100..100 step 5)
number_slider_3 = DoubleSlider(10, range=-100..100 step 5)
code_block_10 = CodeBlock(x=number_slider, y=number_slider_2, z=number_slider_3) { Point.ByCoordinates(x,y,z); }
firstItem_2 = List.FirstItem(list=centroid_2)
getHost = FamilyInstance.GetHost(familyInstance=all_elements_of_category_3)
flatten = List.Flatten(list=allIndicesOf)
getItemAtIndex_2 = List.GetItemAtIndex(list=getHost, index=flatten)
chop = List.Chop(list=getItemAtIndex_2, lengths=count)
flatten_2 = List.Flatten(list=chop)
firstItem_3 = List.FirstItem(list=flatten_2)
boundingBox = Element.BoundingBox(element=firstItem_3)
code_block_11 = CodeBlock { "test"; }
code_block_12 = CodeBlock { true; false; }
byEyePointTargetAndBoundingBox = AxonometricView.ByEyePointTargetAndBoundingBox(eyePoint=code_block_10, target=firstItem_2, boundingBox=boundingBox, name=code_block_11, isolateElement=code_block_12.out0)
firstItem_4 = List.FirstItem(list=byGeometry)
firstItem_5 = List.FirstItem(list=all_elements_of_category_2)

# group: useful after
code_block_13 = CodeBlock { DSCore.Color.ByARGB(100,100,0,0); }
overrideColorInView = Element.OverrideColorInView(element=firstItem_5, color=code_block_13)

toCuboid_4 = BoundingBox.ToCuboid(boundingBox=boundingBox)
code_block_14 = CodeBlock { DSCore.Color.ByARGB(100,100,0,0); }
overrideColorInView_2 = Element.OverrideColorInView(element=firstItem_5, color=code_block_14)
code_block_15 = CodeBlock(x=firstItem_5, y=all_elements_in_active_view) { x==y; }
indexOf = List.IndexOf(list=all_elements_in_active_view, element=firstItem_5)
allIndicesOf_2 = List.AllIndicesOf(list=all_elements_in_active_view, item=firstItem_5)
removeItemAtIndex = List.RemoveItemAtIndex(list=all_elements_in_active_view, indices=allIndicesOf_2)
code_block_16 = CodeBlock { DSCore.Color.ByARGB(1,200,200,200); }
overrideColorInView_3 = Element.OverrideColorInView(element=removeItemAtIndex, color=code_block_16)
code_block_17 = CodeBlock { 0; 1; }
categories_4 = Categories("OST_Doors")
all_elements_of_category_4 = ElementsOfCategory(Category=categories_4)
name_3 = Element.Name(element=all_elements_of_category_4)
watch_6 = Watch(name_3)
exportExcel_2 = Data.ExportExcel(filePath=file_path, sheetName=code_block_2, startRow=code_block_17.out1, startCol=code_block_17.out0, data=watch_6, overWrite=code_block_4)
parameters_3 = Element.Parameters(element=all_elements_of_category_4)
name_4 = Parameter.Name(parameter=parameters_3)
firstItem_6 = List.FirstItem(list=name_4)
code_block_18 = CodeBlock(x=firstItem_6) { [x]; }
ʳʰʸᵗʰᵐ_elements = Rhythm.Revit.Elements.Elements.GetParameterValueByNameCaSeiNSeNSiTiVe(element=all_elements_of_category_4@L1, parameterName=firstItem_6)
join = List.Join(list0=code_block_18, list1=ʳʰʸᵗʰᵐ_elements)
exportExcel_3 = Data.ExportExcel(filePath=file_path, sheetName=code_block_2, startRow=code_block_17.out0, startCol=code_block_3.out1, data=join, overWrite=code_block_4)
watch_7 = Watch()  # unwired: arg0
watch_8 = Watch(ʳʰʸᵗʰᵐ_elements)

# group: Loads all elements of type doors or windows
categories_5 = Categories("OST_Doors")
all_elements_of_category_5 = ElementsOfCategory(Category=categories_5)
categories_6 = Categories("OST_Windows")
all_elements_of_category_6 = ElementsOfCategory(Category=categories_6)

# group: Create one list of elements
join_2 = List.Join(list0=all_elements_of_category_5, list1=all_elements_of_category_6)
watch_9 = Watch(join_2)

# group: Extract Geometry of all elements
geometry_3 = Element.Geometry(element=join_2)
byGeometry_4 = BoundingBox.ByGeometry(geom=geometry_3)
toCuboid_5 = BoundingBox.ToCuboid(boundingBox=byGeometry_4)

# group: Calculate the volume of all elements
volume = Solid.Volume(solid=toCuboid_5)
volume_per_element_m³ = Watch(volume)
sum = Math.Sum(values=volume)
total_volume_to_store_m³ = Watch(sum)

# group: Extract all the rooms
categories_7 = Categories("OST_Rooms")
all_elements_of_category_7 = ElementsOfCategory(Category=categories_7)
name_5 = Element.Name(element=all_elements_of_category_7)

# group: Get their geometry and volume
name_6 = Element.Name(element=all_elements_of_category_7)
geometry_4 = Element.Geometry(element=all_elements_of_category_7)
volume_2 = Solid.Volume(solid=geometry_4)
volume_per_element_m³_2 = Watch(volume_2)

# group: Keep rooms with volume > volume of stored elements
flatten_3 = List.Flatten(list=volume_per_element_m³_2)
code_block_19 = CodeBlock(x=flatten_3, y=total_volume_to_store_m³) { x>y; }
filterByBoolMask = List.FilterByBoolMask(list=all_elements_of_category_7, mask=code_block_19)
list_of_rooms_with_a_sufficient = Watch(filterByBoolMask.in)  # "List of rooms with a sufficient volume to store these elements"

# group: Keep only rooms in the ground floor (easy access)
code_block_20 = CodeBlock { "Level"; }
getParameterValueByName = Element.GetParameterValueByName(element=list_of_rooms_with_a_sufficient, parameterName=code_block_20)
code_block_21 = CodeBlock(x=getParameterValueByName) { x=="Level 0"; }
filterByBoolMask_2 = List.FilterByBoolMask(list=list_of_rooms_with_a_sufficient, mask=code_block_21)
list_of_rooms_with_a_sufficient_2 = Watch(filterByBoolMask_2.in)  # "List of rooms with a sufficient volume to store these elements & ground floor"

# group: Sort rooms by volume (smallest first)
code_block_22 = CodeBlock(x=list_of_rooms_with_a_sufficient_2) { x.Name; }
filterByBoolMask_3 = List.FilterByBoolMask(list=flatten_3, mask=code_block_19)
filterByBoolMask_4 = List.FilterByBoolMask(list=filterByBoolMask_3.in, mask=code_block_21)
sortIndexByValue = List.SortIndexByValue(list=filterByBoolMask_4.in)
sorted_list_of_rooms_by = List.Reorder(list=code_block_22, indices=sortIndexByValue)  # "Sorted List of rooms (by ascending volume)"
