# Dynamo graph IsolatePartsinView.dyn (Dynamo 2.10.1.3976)
# packages: spring nodes 210.1.1, Rhythm 2022.3.3, SteamNodes 1.2.4

boolean = BoolSelector(true)
ʳʰʸᵗʰᵐ_selection_pick = Rhythm.Revit.Selection.Selection.Pick(runIt=boolean)
code_block = CodeBlock(wait=ʳʰʸᵗʰᵐ_selection_pick) { wait; true; }
ꟿ_document_activeview = Custom[ꟿ Document.ActiveView](refresh=code_block.out1)  # package spring nodes; Selects the current document's active view. Supports more view types than the built-in option. Will be depreciated once the bult in node works with all plan types.
code_block_2 = CodeBlock { "ShowPartsOnly"; }
setPartsVisibility = View.SetPartsVisibility(view=ꟿ_document_activeview, partsVisibility=code_block_2)
getParts = Custom[Element.GetParts](code_block.wait)  # package SteamNodes; Get parts for the elements from Input. Returns Parts and Parent elements
flatten = List.Flatten(list=getParts.Parts)
isolateElementsTemporary = View.IsolateElementsTemporary(view=setPartsVisibility, elements=flatten)
