# Dynamo graph MaterialtoParts.dyn (Dynamo 2.13.1.3887)
# packages: SteamNodes 1.2.4, Rhythm 2022.3.3

# group: SELECT BASE ELEMENT
code_block = CodeBlock { 1557092; }
element_by_id = ElementById(Id=code_block)

select_model_element = DSModelElementSelection()  # 1 picked in the model; graph input
code_block_2 = CodeBlock(element=select_model_element) { element; }
getMaterials = Element.GetMaterials(element=code_block_2)
parameter_name = StringInput("test")  # graph input
parameterByName = Parameter.ParameterByName(element=getMaterials, name=parameter_name)
code_block_3 = CodeBlock {  }
getParts = Custom[Element.GetParts](code_block_2)  # package SteamNodes; Get parts for the elements from Input. Returns Parts and Parent elements
ʳʰʸᵗʰᵐ_elements = Rhythm.Revit.Elements.Elements.GetParameterValueByNameTypeOrInstance(element=getMaterials, parameterName=parameter_name)
code_block_4 = CodeBlock(x=getParts.Parts, parameterName=parameter_name, parameterValue=ʳʰʸᵗʰᵐ_elements) { t1 = List.Flatten(x, -1); element1 = Elements.Element.SetParameterByName(t1, parameterName, ""+parameterValue+""); }
family_types = FamilyTypes()  # nothing selected
element_classes = ElementTypes("SharedParameterElement")
all_elements_of_class = ElementsOfType(element_class=element_classes)
code_block_5 = CodeBlock(x=all_elements_of_class) { x.Name; }
code_block_6 = CodeBlock(x=code_block_5) { x=="test"; }
scopeIf = ScopedIf()  # unwired: test, true, false
