# Dynamo graph RoomRenaming.dyn (Dynamo 2.0.2.6826)

code_block = CodeBlock { true; }
collect_rooms_and_spaces = Custom[Collect Rooms and Spaces](collect=code_block)  # Collect rooms and MEP spaces in the Revit document. Use "Rooms to HBZones" node to convert them to Honeybee zones.
code_block_2 = CodeBlock(x=collect_rooms_and_spaces.rooms) { x; }
code_block_3 = CodeBlock { "Name"; }
getParameterValueByName = Element.GetParameterValueByName(element=code_block_2, parameterName=code_block_3)
watch = Watch(getParameterValueByName)
code_block_4 = CodeBlock { "Name"; }
code_block_5 = CodeBlock { "Level"; }
getParameterValueByName_2 = Element.GetParameterValueByName(element=code_block_2, parameterName=code_block_5)
code_block_6 = CodeBlock { "Area"; }
getParameterValueByName_3 = Element.GetParameterValueByName(element=code_block_2, parameterName=code_block_6)
code_block_7 = CodeBlock(a=getParameterValueByName_2, b=getParameterValueByName, c=getParameterValueByName_3) { a+" "+b+" "+c; }
setParameterByName = Element.SetParameterByName(element=code_block_2, parameterName=code_block_4, value=code_block_7)
id = Parameter.Id()  # unwired: parameter
parameters = Element.Parameters(element=code_block_2)
