# Dynamo graph SliderCheck.dyn (Dynamo 2.10.1.3976)
# packages: Clockwork for Dynamo 0.7.x 0.75.24, Data-Shapes 2022.2.103

element_number = IntegerSlider(14, range=0..1000 step 1)  # graph input

# group: Do not touch
activeViewFromCurrentDocument = Custom[Document.ActiveViewFromCurrentDocument]()  # package Clockwork for Dynamo 0.7.x; Gets the active view of the current document
code_block = CodeBlock { false; }
code_block_2 = CodeBlock { true; }

disableTemporaryHideIsolate = Custom[View.DisableTemporaryHideIsolate](view=activeViewFromCurrentDocument)  # package Clockwork for Dynamo 0.7.x; Disables the temporary hide/isolate for the given view (if set)
all_elements_in_view_s = Custom[All Elements In View(s)](Views=disableTemporaryHideIsolate)  # package Data-Shapes; Retrieves all visible element in a view or a set of views
flatten = List.Flatten(list=all_elements_in_view_s)

# group (continued): Do not touch
code_block_3 = CodeBlock(el=flatten, wait=disableTemporaryHideIsolate)
# ---------- code_block_3.designscript (3 lines) ----------
Elements.Element.GetParameterValueByName(el,"AnimationOrder");
Elements.Element.GetParameterValueByName(el,"AnimationOrderOFF");
wait;
# ----------------------------------------
sortByKey = List.SortByKey(list=flatten, keys=code_block_3.out0)
code_block_4 = CodeBlock(key=code_block_3.out0, x=element_number) { key<=x; }
replaceNull = Custom[List.ReplaceNull](list=code_block_4, replacement=code_block)  # package Clockwork for Dynamo 0.7.x; Replaces all null values within a given list with a substitute
filterByBoolMask = List.FilterByBoolMask(list=flatten, mask=replaceNull)

sortByKey_2 = List.SortByKey(list=code_block_3.out1, keys=code_block_3.out0)
filterByBoolMask_2 = List.FilterByBoolMask(list=code_block_3.out1, mask=replaceNull)

# group (continued): Do not touch
code_block_5 = CodeBlock(key=filterByBoolMask_2.in, x=element_number) { key>x; }
replaceNull_2 = Custom[List.ReplaceNull](list=code_block_5, replacement=code_block_2)

filterByBoolMask_3 = List.FilterByBoolMask(list=filterByBoolMask.in, mask=replaceNull_2)
join = List.Join(list0=filterByBoolMask.out, list1=filterByBoolMask_3.out)
clean = List.Clean(list=join)
hideElementsTemporary = View.HideElementsTemporary(view=code_block_3.wait, elements=clean)
eléments_cachés = Watch(clean)  # graph output
eléments_visibles = Watch(filterByBoolMask_3.in)  # graph output
