# Dynamo graph v3.dyn (Dynamo 1.3.4.6666)

firstItem = List.FirstItem()  # unwired: arg0
string_from_object = FromObject(firstItem)
file_path = Filename(".\Tarkett-vloeren_LRV waarden - BBRI.xlsx")
fromPath = FileObject(file_path)  # "File.FromPath"
code_block = CodeBlock { "LinoleumBBRI"; }
code_block_2 = CodeBlock { true; }
readFromFile = Excel.ReadFromFile(file=fromPath, sheetName=code_block, readAsStrings=code_block_2)
code_block_3 = CodeBlock(x=readFromFile) { x[0]; }
code_block_4 = CodeBlock { 3; }
code_block_5 = CodeBlock { 0; }
removeItemAtIndex = List.RemoveItemAtIndex(list=readFromFile, indices=code_block_5)
code_block_6 = CodeBlock { 2; }
takeItems = List.TakeItems(list=removeItemAtIndex@L2, amount=code_block_6)
code_block_7 = CodeBlock(x=code_block) { x+"BBRI"; }
code_block_8 = CodeBlock(x=code_block_7) { x; }
code_block_9 = CodeBlock { 1; 0; "HomogeenSorted"; }
code_block_10 = CodeBlock { 0; }
getItemAtIndex = List.GetItemAtIndex(list=removeItemAtIndex@L2, index=code_block_10)
code_block_11 = CodeBlock { 2; }
dropItems = List.DropItems(list=removeItemAtIndex@L2, amount=code_block_11)
code_block_12 = CodeBlock { -1; }
dropItems_2 = List.DropItems(list=dropItems@L2, amount=code_block_12)
code_block_13 = CodeBlock(x=dropItems_2) { x; }
isNull = Object.IsNull(code_block_13@L2)
countFalse = CountFalse(isNull@L2)
ofRepeatedItem = List.OfRepeatedItem(item=getItemAtIndex@L1, amount=countFalse@L1)
flatten = Flatten(ofRepeatedItem)
code_block_14 = CodeBlock { 1; }
getItemAtIndex_2 = List.GetItemAtIndex(list=removeItemAtIndex@L2, index=code_block_14)
ofRepeatedItem_2 = List.OfRepeatedItem(item=getItemAtIndex_2@L1, amount=countFalse@L1)
flatten_2 = Flatten(ofRepeatedItem_2)
code_block_15 = CodeBlock { false; }
clean = List.Clean(list=code_block_13, preserveIndices=code_block_15)
flatten_3 = Flatten(clean)
code_block_16 = CodeBlock { 8; 9; }
create = List.Create(code_block_16.out0, code_block_16.out1)
removeItemAtIndex_2 = List.RemoveItemAtIndex(list=removeItemAtIndex@L2, indices=create)
code_block_17 = CodeBlock { 4; 9; }
getItemAtIndex_3 = List.GetItemAtIndex(list=removeItemAtIndex_2@L2, index=code_block_17.out1)
ofRepeatedItem_3 = List.OfRepeatedItem(item=getItemAtIndex_3@L1, amount=countFalse@L1)
flatten_4 = Flatten(ofRepeatedItem_3)
create_2 = List.Create(flatten, flatten_2, flatten_3, flatten_4)
transpose = List.Transpose(create_2)
code_block_18 = CodeBlock { true; }
writeToFile = Excel.WriteToFile(filePath=file_path, sheetName=code_block_8, startRow=code_block_9.out0, startCol=code_block_9.out1, data=transpose, overWrite=code_block_18)
create_3 = List.Create()  # unwired: arg0, arg1, arg2
getItemAtIndex_4 = List.GetItemAtIndex(list=removeItemAtIndex_2@L2, index=code_block_17.out0)
ofRepeatedItem_4 = List.OfRepeatedItem(item=getItemAtIndex_4@L1, amount=countFalse@L1)
flatten_5 = Flatten(ofRepeatedItem_4)
code_block_19 = CodeBlock(x=flatten_3, y=flatten_5) { x+y; }
