# Dynamo graph TestARplans.dyn (Dynamo 2.10.1.3976)
# packages: JsonData 2.0.2, Genius Loci 2022.4.19, Rhythm 2022.3.3, GIS2BIM for Dynamo 2.x 0.11.23, QRImage 0.0.5, QRCoder 0.9.0 2016.1.15, Clockwork for Dynamo 0.7.x 0.75.24

# group: Detail Info
# note: -clipping box
# -export GLB
# note: username:
# u144758262.xrbbri
# Password
# Arvr2022!
# ftp://arvr.site

code_block = CodeBlock { ["objectURL","offset","rotation","scale","name","description","QRwidth","QRFile"]; }
file_path_model_export = Filename("..\..\..\..\..\Documents\bb976c4a63b94779a8111d8e05c67ef9.gltf")  # graph input
code_block_2 = CodeBlock { false; }
fileName = FileSystem.FileName(path=file_path_model_export, withExtension=code_block_2)
code_block_3 = CodeBlock(nameGLB=fileName)
# ---------- code_block_3.designscript (4 lines) ----------
"http://arvr.site/ARplan/DESCRIPTIONS/"+"DemoDescriptionDataset.json";
"http://arvr.site/ARplan/GEOMETRIES/"+nameGLB+".gltf";
"http://arvr.site/ARplan/QRCODES/"+nameGLB+".jpg";
"/"+nameGLB+".jpg";
# ----------------------------------------

# group: Input
only_qr_code = BoolSelector(false)  # graph input

# group: Input
select_model_element = DSModelElementSelection()  # 1 picked in the model; graph input

code_block_4 = CodeBlock(x=select_model_element) { x.Location; }

# group: input
mm_to_unit_ratio_1_if_mm_1000_if = DoubleInput(1000)  # "mm to unit ratio (1 if mm, 1000 if m)"; graph input

code_block_5 = CodeBlock(x=code_block_4, unit=mm_to_unit_ratio_1_if_mm_1000_if) { (x.X)*unit; (x.Y)*unit; }

# group: input
activeViewFromCurrentDocument = Custom[Document.ActiveViewFromCurrentDocument]()  # package Clockwork for Dynamo 0.7.x; Gets the active view of the current document
sheet_to_print = Views("Unnamed")

code_block_6 = CodeBlock(view=activeViewFromCurrentDocument) { view; }
ʳʰʸᵗʰᵐ_sheet = Rhythm.Revit.Elements.Sheet.GetViewportsAndViews(sheet=code_block_6)
ʳʰʸᵗʰᵐ_viewport_locationdata = Rhythm.Revit.Elements.Viewport.LocationData(viewport=ʳʰʸᵗʰᵐ_sheet.viewports)
minPoint = BoundingBox.MinPoint(boundingBox=ʳʰʸᵗʰᵐ_viewport_locationdata.bBox)
code_block_7 = CodeBlock(x=minPoint) { x.X; x.Y; }
view_cropbox = Custom[View CropBox](view=ʳʰʸᵗʰᵐ_sheet.views)  # package Genius Loci; Obtain the CropBox, the SectionBox, the SectionMarker or the ElevationMarker element of the given view. Retrieve also the CropBox curves and the BoundingBox.
minPoint_2 = BoundingBox.MinPoint(boundingBox=view_cropbox.BoundingBox)
code_block_8 = CodeBlock(x=minPoint_2) { x.X; x.Y; }
scale = View.Scale(view=ʳʰʸᵗʰᵐ_sheet.views)
code_block_9 = CodeBlock(x=code_block_8.out0, scale=scale, y=code_block_8.out1) { (x/scale); (y/scale); }
code_block_10 = CodeBlock(x=code_block_7.out0, x2=code_block_9.out0, unit=mm_to_unit_ratio_1_if_mm_1000_if, y=code_block_7.out1, y2=code_block_9.out1) { (x-x2)*unit; (y-y2)*unit; }
code_block_11 = CodeBlock(Xqr=code_block_5.out0, Xcenter=code_block_10.out0, Yqr=code_block_5.out1, Ycenter=code_block_10.out1) { (-Xqr+Xcenter)/1000; (-Yqr+Ycenter)/1000; }
flatten = List.Flatten(list=code_block_11.out0)
code_block_12 = CodeBlock { 0; }
flatten_2 = List.Flatten(list=code_block_11.out1)
code_block_13 = CodeBlock(x=flatten, z=code_block_12, y=flatten_2) { [x,z,y]; }
flatten_3 = List.Flatten(list=code_block_13)
titleBlock = Sheet.TitleBlock(sheet=code_block_6)
code_block_14 = CodeBlock(el=titleBlock)
# ---------- code_block_14.designscript (4 lines) ----------
dy=Elements.Element.GetParameterValueByName(el,"Sheet Height");
dx=Elements.Element.GetParameterValueByName(el,"Sheet Width");
cx=dx/2;
cy=dy/2;
# ----------------------------------------
code_block_15 = CodeBlock(x=titleBlock, dx=code_block_14.cx, dy=code_block_14.cy) { p=x.Location; newx=p.X+dx; newy=p.Y+dy; }
code_block_16 = CodeBlock(x=code_block_15.newx, unit=mm_to_unit_ratio_1_if_mm_1000_if, y=code_block_15.newy) { (x)*unit; (y)*unit; }
code_block_17 = CodeBlock(Xqr=code_block_16.out0, Xcenter=code_block_10.out0, Yqr=code_block_16.out1, Ycenter=code_block_10.out1) { (-Xqr+Xcenter)/1000; (-Yqr+Ycenter)/1000; }
code_block_18 = CodeBlock { 0; }
code_block_19 = CodeBlock(x=code_block_17.out0, z=code_block_18, y=code_block_17.out1) { [x,z,y]; }
flatten_4 = List.Flatten(list=code_block_19)
if_ = If(test=only_qr_code, true=flatten_3, false=flatten_4)
code_block_20 = CodeBlock(scale=scale) { [-90,180,0]; [1/(scale*1000),1/(scale*1000),1/(scale*1000)]; }
flatten_5 = List.Flatten(list=code_block_20.out1)
projectInfo = Custom[Document.ProjectInfo]()  # package Clockwork for Dynamo 0.7.x; Gets the project information.
code_block_21 = CodeBlock(a=projectInfo.ClientName, b=projectInfo.BuildingName) { ""+a+"_"+b; }
code_block_22 = CodeBlock { 0.1; }
if_2 = If(test=only_qr_code, true=code_block_22, false=code_block_14.dx)
firstItem = List.FirstItem(list=if_2)
code_block_23 = CodeBlock(objectURL=code_block_3.out1, offset=if_, rotation=code_block_20.out0, scale=flatten_5, name=code_block_21, description=code_block_3.out0, QRwidth=firstItem, QRFile=code_block_3.out2) { [objectURL,offset,rotation,scale,name,description,QRwidth,QRFile]; }
byKeysAndValues = JsonObject.ByKeysAndValues(keys=code_block, values=code_block_23, Nesting=false, Option="None")
code_block_24 = CodeBlock { 0; }
code_block_25 = CodeBlock { 0; }
watch = Watch(code_block_10.out1)
watch_2 = Watch(code_block_10.out0)
code_block_26 = CodeBlock(xmodel=code_block_8.out0, xsheet=code_block_7.out0, ymodel=code_block_8.out1, ysheet=code_block_7.out1) { xmodel-xsheet; ymodel-ysheet; }
watch_3 = Watch(code_block_26.out0)
maxPoint = BoundingBox.MaxPoint(boundingBox=ʳʰʸᵗʰᵐ_viewport_locationdata.bBox)
code_block_27 = CodeBlock(x=maxPoint) { x.X; x.Y; }
code_block_28 = CodeBlock(xmax=code_block_27.out0, xmin=code_block_7.out0, ymax=code_block_27.out1, ymin=code_block_7.out1) { xmax-xmin; ymax-ymin; }
watch_4 = Watch(code_block_28.out0)
maxPoint_2 = BoundingBox.MaxPoint(boundingBox=view_cropbox.BoundingBox)
code_block_29 = CodeBlock(x=maxPoint_2) { x.X; x.Y; }
code_block_30 = CodeBlock(xmax=code_block_29.out0, xmin=code_block_8.out0, ymax=code_block_29.out1, ymin=code_block_8.out1) { xmax-xmin; ymax-ymin; }
watch_5 = Watch(code_block_30.out0)
code_block_31 = CodeBlock { 1; }
hide_annotations = Python(IN[0]=ʳʰʸᵗʰᵐ_sheet.views)  # IronPython2
# ---------- hide_annotations.python (37 lines) ----------
# Load the Python Standard and DesignScript Libraries
import sys
import clr
clr.AddReference('ProtoGeometry')
from Autodesk.DesignScript.Geometry import *

clr.AddReference("RevitNodes")
import Revit
clr.ImportExtensions(Revit.Elements)

clr.AddReference("RevitServices")
import RevitServices
from RevitServices.Persistence import DocumentManager
from RevitServices.Transactions import TransactionManager

# The inputs to this node will be stored as a list in the IN variables.
dataEnteringNode = IN
Input = UnwrapElement(IN[0])

doc = DocumentManager.Instance.CurrentDBDocument
uiapp = DocumentManager.Instance.CurrentUIApplication
app = uiapp.Application
TransactionManager.Instance.EnsureInTransaction(doc)

viewsOut = []

if isinstance(IN[0], list):
	for View in Input:
		View.AreAnnotationCategoriesHidden = 1
		viewsOut.append(View)
else:
	Input.AreAnnotationCategoriesHidden = 1
	viewsOut.append(Input)

TransactionManager.Instance.TransactionTaskDone()

OUT = viewsOut
# ----------------------------------------
code_block_32 = CodeBlock(scale=scale) { 1/scale; }
code_block_33 = CodeBlock(x=ʳʰʸᵗʰᵐ_viewport_locationdata.boxCenter) { x.X; x.Y; }
code_block_34 = CodeBlock(x=code_block_33.out0, y=code_block_33.out1) { x*1000; y*1000; }
code_block_35 = CodeBlock { 770; 530; }
code_block_36 = CodeBlock { 0.8; 0.4; }
code_block_37 = CodeBlock { "objects"; }
file_path = Filename("ARplan\dataset.json")
fromJsonFile = JsonData.Utilities.Read.FromJsonFile(filepath=file_path)
code_block_38 = CodeBlock { "objects"; }
getValueByKey = JsonObject.GetValueByKey(jsonObject=fromJsonFile, keys=code_block_38, Nesting=false, Option="None")
byKeysAndValues_2 = JsonObject.ByKeysAndValues(keys=code_block, values=code_block_23, Nesting=false, Option="None")
join = List.Join(list0=getValueByKey, list1=byKeysAndValues_2)
code_block_39 = CodeBlock(x=join) { [x]; }
byKeysAndValues_3 = JsonObject.ByKeysAndValues(keys=code_block_37, values=code_block_39, Nesting=false, Option="None")
toJsonFile = JsonData.Utilities.Write.ToJsonFile(jsonObjects=byKeysAndValues_3, filepath=file_path)
file_path_2 = Filename("ARplan\QRCODES\planQR.jpg")
QRCode = Custom[QRCode](str=fileName)  # package QRCoder 0.9.0; Creates a simple QR code based on strings. Accepts single items or lists
watch_image = WatchImageCore(image=QRCode)
saveAsImage = Image.SaveAsImage(path=file_path_2, image=watch_image)
code_block_40 = CodeBlock(view=code_block_6) { view; }

# group: Input
directory_path = Directory("C:\Users\fd\OneDrive - CSTC-WTCB-BBRI\Documents\01.BBRI\02.Projets\01.AR\ARplan\QRCODES")  # graph input

code_block_41 = CodeBlock(a=directory_path, b=code_block_3.out3) { a+b; }
exportAsImage = View.ExportAsImage(view=code_block_40, path=code_block_41)
GIS2BIM_ImportImageInView = Custom[GIS2BIM_ImportImageInView](ImageWidthMeters=code_block_22, view=code_block_6, ImagePath=file_path_2, DeltaX=code_block_5.out0, DeltaY=code_block_5.out1)  # package GIS2BIM for Dynamo 2.x; Import rasterimage in view
code_block_42 = CodeBlock(wait=GIS2BIM_ImportImageInView, view=code_block_6) { wait; view; }
code_block_43 = CodeBlock(x=titleBlock) { x.Parameters; }
watch_6 = Watch(code_block_16.out1)
GIS2BIM_ImportImageInView_2 = Custom[GIS2BIM_ImportImageInView](ImageWidthMeters=code_block_22, view=code_block_6, ImagePath=file_path_2, DeltaX=code_block_10.out0, DeltaY=code_block_10.out1)  # frozen
watch_7 = Watch(code_block_16.out0)
code_block_44 = CodeBlock { 0; }
code_block_45 = CodeBlock { 0; }
code_block_46 = CodeBlock { 0.05; }
GIS2BIM_ImportImageInView_3 = Custom[GIS2BIM_ImportImageInView](ImageWidthMeters=code_block_46, view=code_block_6, ImagePath=file_path_2, DeltaX=code_block_16.out0, DeltaY=code_block_16.out1)  # frozen
watch_8 = Watch(code_block_15.p)
join_2 = List.Join(list0=getValueByKey, list1=byKeysAndValues_2)
fromJsonFile_2 = JsonData.Utilities.Read.FromJsonFile(filepath=file_path_model_export)
code_block_47 = CodeBlock { "scene"; }
code_block_48 = CodeBlock { 0; }
add = JsonObject.Add(jsonObject=fromJsonFile_2, keys=code_block_47, values=code_block_48, Nesting=false, Option="None")
jsonToString = JsonData.Utilities.Parse.JsonToString(jsonObjects=add)
writeText = FileSystem.WriteText(filePath=file_path_model_export, text=jsonToString)
code_block_49 = CodeBlock {  }
code_block_50 = CodeBlock {  }
code_block_51 = CodeBlock { Point.ByCoordinates(0.05,0.05,0); }
code_block_52 = CodeBlock { 0; }
