# Dynamo graph TestAutocad.dyn (Dynamo 2.10.1.3976)
# packages: Genius Loci 2022.4.19, bimorphNodes 4.2.1, LinkDWG 0.3.91

code_block = CodeBlock {  }
select_model_element = DSModelElementSelection()  # 1 picked in the model
cad_block = Custom[CAD Block](importInstance=select_model_element)  # package Genius Loci; Get the location point, name and layer of the CAD blocks / XRefs from a CAD link or import. Please note : The non-uniform scaling of blocks is not supported (The X, Y and Z values ​​of the Block Scale must be the same).
code_block_2 = CodeBlock { true; }
code_block_3 = CodeBlock { "furniture"; }
pointsFromCADLayers = CAD.PointsFromCADLayers()  # unwired: importInstance
groupGeometriesByLayer = Custom[GroupGeometriesByLayer](importInstance=select_model_element)  # package LinkDWG; Group geometries in ImportInstance by their layer name and convert the inside meshes into polysurface
watch = Watch(groupGeometriesByLayer.2_Layer_Names)
code_block_4 = CodeBlock { 6; }
getItemAtIndex = List.GetItemAtIndex(list=groupGeometriesByLayer.0_Grouped_Geometries, index=code_block_4)
curves_fromhatch = Custom[Curves FromHatch]()  # package Genius Loci; Gets the boundaries of the hatches from a CAD link or import. By Cyril Poupin on the Dynamo Forum; unwired: importInstance
